# Grasshopper definition AsyncObjectManagementTests.ghx (Grasshopper 1.0.7)
# plug-ins: Speckle 2

box = CenterBox(Base=PlaneXY(0, 0, 0), X=1, Y=1, Z=1)
domain = Domain("0 to 34")
brep = Brep(box)
repeat = RepeatData(Data=brep, Length=Slider(1000, range=0..1000))
csoa = CreateSpeckleObjectAsync(A=brep, B=repeat, C="0 to 34")
to_speckle = ToSpeckle(Objects=brep, KitName="Objects")
cso = CreateSpeckleObject(A=domain, B=brep)
esoa = ExpandSpeckleObjectAsync(SpeckleObject=csoa)  # -> A, B, C
to_native = ToNative(SpeckleObjects=to_speckle, KitName="Objects")
entwine = Entwine(Branch00=brep, FlattenInputs=True)
eso = ExpandSpeckleObject(SpeckleObject=cso)  # -> A, B
entwine_2 = Entwine(Branch00=esoa.C, Branch01=esoa.C, FlattenInputs=True)
panel = Panel("""First
Second""")
esoa_2 = ExtendSpeckleObjectAsync(SpeckleObject=csoa, Keys="Third", Values=entwine)
k_v_async = CreateSpeckleObjectByKeyValueAsync(Keys=panel, Values=entwine_2)  # -> flatten(Object)
esoa_3 = ExpandSpeckleObjectAsync(SpeckleObject=esoa_2)  # -> A, B, C, Third
esoa_4 = ExpandSpeckleObjectAsync(SpeckleObject=k_v_async)  # -> First, Second
panel_2 = Panel(esoa_4.First)
