# Grasshopper definition BrepTest.ghx (Grasshopper 1.0.7)
# plug-ins: Speckle 2, MeshEdit Components, Human

number_slider = Slider(3, range=0..10)
number_slider_2 = Slider(0.4, range=0..1)
number_slider_3 = Slider(2, range=0..10)
range = Range(Domain="-2 to 2", Steps=number_slider)
pt = Point(Point(0, -0.2430274182, 0))
pt_2 = Point(Point(-0.2375516705, 0.07208809119, -0.2489613433))
pt_3 = Point(Point(0.7966847394, 0.07208809119, 0.135139581))
pt_4 = Point(Point(0.7966847394, 0.07208809119, 1.252480454))
pt_5 = ConstructPoint(XCoordinate=graft(range), YCoordinate=range, ZCoordinate=0)
cyl = Cylinder(Base=pt, Radius=0.5, Length=Slider(1, range=0..10))
box = CenterBox(Base=pt_4, X=number_slider_2, Y=number_slider_2, Z=number_slider_3)
box_2 = CenterBox(Base=pt_3, X=number_slider_3, Y=number_slider_2, Z=number_slider_2)
box_3 = CenterBox(Base=pt_2, X=number_slider_2, Y=number_slider_3, Z=number_slider_2)
box_4 = CenterBox(Base=PlaneXY(0, 0, 0), X=1, Y=1, Z=1)
cap = CapHoles(Brep=cyl)
brep = Brep(box_4)
pt_6 = Point(Tree({0;0;0}: [Point(-2, -2, 0), Point(-2, -0.6666666667, 0), Point(-2, 0.6666666667, 0), Point(-2, 2, 0)], {0;0;1}: [Point(-0.6666666667, -2, 0), Point(-0.6666666667, -0.6666666667, -1.468956097), Point(-0.6666666667, 0.6666666667, 1.305453651), Point(-0.6666666667, 2, -0.9238310205)], {0;0;2}: [Point(0.6666666667, -2, 0), Point(0.6666666667, -0.6666666667, 2.759774879), Point(0.6666666667, 0.6666666667, -0.1358726263), Point(0.6666666667, 2, 0)], {0;0;3}: [Point(2, -2, -1.643371203), Point(2, -0.6666666667, 0), Point(2, 0.6666666667, 0), Point(2, 2, 0)]))
pt_7 = Point(Tree({0;0;0}: [Point(-2, 0, -2), Point(-2, 0, -0.6666666667), Point(-2, -1.157601878, 0.6666666667), Point(-2, -1.531644715, 2)], {0;0;1}: [Point(-0.6666666667, 0, -2), Point(-0.6666666667, -0.339197191, -0.6666666667), Point(-0.6666666667, 2.598013607, 0.6666666667), Point(-0.6666666667, 0, 2)], {0;0;2}: [Point(0.6666666667, -1.084035409, -2), Point(0.6666666667, 0.2769907449, -0.6666666667), Point(0.2187878199, -0.6758975856, 0.6666666667), Point(0.6666666667, -0.9859577286, 2)], {0;0;3}: [Point(2, 0, -2), Point(2, 2.242105939, -0.6666666667), Point(2, 0, 0.6666666667), Point(2, 0, 2)]))
relay = Relay([box, box_2, box_3])
srfgrid = SurfaceFromPoints(Points=flatten(pt_6), UCount=expr("x+1", number_slider), Interpolate=False)
srfgrid_2 = SurfaceFromPoints(Points=flatten(pt_7), UCount=expr("x+1", number_slider), Interpolate=invert(True))
Z = UnitZ(Factor=Slider(0.5687, range=-1..1))
move = Move(Geometry=srfgrid, Motion=Z)  # -> Geometry, Transform
flip = Flip(Surface=move.Geometry)  # -> Surface, Result
relay_2 = Relay([move.Geometry, srfgrid_2])
sdiff = SolidDifference(BrepsA=brep, BrepsB=cap)
sdiff_2 = SolidDifference(BrepsA=brep, BrepsB=relay)
sdiff_3 = SolidDifference(BrepsA=brep, BrepsB=box_3)
sdiff_4 = SolidDifference(BrepsA=sdiff_2, BrepsB=cap)
sunion = SolidUnion(Breps=[srfgrid, srfgrid_2])
sdiff_5 = SolidDifference(BrepsA=sdiff_4, BrepsB=flip.Surface)
pt_8 = Point([Point(-7.817333337, -6.253343826, 0), Point(-10.02456968, 4.172836202, 1.830920992), Point(10.16226121, 8.408412446, 0), Point(8.777132862, -4.740103994, 0), Point(28.25383308, -7.153124511, 0), Point(27.50993698, 8.01810969, 0)])
edges = BrepEdges(Brep=sdiff_4)  # -> Naked, Interior, NonManifold
item = ListItem(List=pt_8, Index=0, Wrap=True)  # -> Item, Item1, Item2, Item3, Item4, Item5

number_slider_4 = Slider(1, range=0..1)
srf = Surface(reparameterize(srfgrid_2))
pt_9 = Point([Point(0.2304264784, 0.1245065727, 0), Point(0.1174252386, 0.5301330901, 0), Point(0.4398833213, 0.8202184117, 0), Point(0.8470526571, 0.4339624696, 0), Point(0.7045404598, 0.1754018585, 0)])
rectangle = Rectangle(Plane=PlaneXY(0, 0, 0), XSize=number_slider_4, YSize=number_slider_4, Radius=0)  # -> Rectangle, Length
srf_2 = Surface(reparameterize(rectangle.Rectangle))
pline = PolyLine(Vertices=pt_9, Closed=invert(False))
nurbs = NurbsCurve(Vertices=pt_9, Degree=3, Periodic=invert(False))  # -> Curve, Length, Domain
explode = Explode(Curve=pline, Recursive=True)  # -> Segments, Vertices
map_srf = MapToSurface(Curve=nurbs.Curve, Source=srf_2, Target=srf)
panel = Panel("""0.5
1""")
shatter = Shatter(Curve=reparameterize(map_srf), Parameters=panel)
srfsplit = SurfaceSplit(Surface=srf, Curves=shatter)
item_2 = ListItem(List=srfsplit, Index=0, Wrap=True)  # -> Item, Item1

preview = CustomPreview(Geometry=sdiff_4, Material=ColourSwatch(SwatchColor=RGB(255, 255, 255)))
srf4pt = _4PointSurface(CornerA=item.Item, CornerB=item.Item1, CornerC=item.Item2, CornerD=item.Item3)
srf4pt_2 = _4PointSurface(CornerA=item.Item3, CornerB=item.Item2, CornerC=item.Item5, CornerD=item.Item4)
previewlw = CustomPreviewLineweights(
    Geometry=edges.Interior,
    Shader={diffuse=RGB(255, 105, 180), emission=RGB(76, 32, 54), shine=0.5, specular=RGB(255, 255, 255), transparency=0},
    Thickness=Slider(5, range=0..10),
    Absolute=False)
join = BrepJoin(Breps=[srf4pt, srf4pt_2])  # -> Breps, Closed

msphereex = MeshSphereEx(Base=PlaneXY(0, 0, 0), Radius=10, Count=5)
explode_2 = MeshExplode(Mesh=msphereex, Interpolate=False)
split = SplitList(List=explode_2, Index=Slider(100, range=0..100))  # -> ListA, ListB
demesh = DeconstructMesh(Mesh=split.ListA)  # -> Vertices, Faces, Colours, Normals
item_3 = ListItem(List=demesh.Vertices, Index=0, Wrap=True)  # -> Item, Item1, Item2, Item3, Item4
srf4pt_3 = _4PointSurface(CornerA=item_3.Item, CornerB=item_3.Item1, CornerC=item_3.Item2, CornerD=item_3.Item3)
join_2 = BrepJoin(Breps=flatten(srf4pt_3))  # -> Breps, Closed

md_slider = MDSlider(
    SliderMode=0,
    slider_value=Point(0.04854523189, 0.9682475765, 0.5),
    x_domain=Domain(0, 1),
    y_domain=Domain(0, 1),
    z_domain=Domain(0, 1))
evalsrf = EvaluateSurface(Surface=reparameterize(srfgrid_2), Point=md_slider)  # -> Point, Normal, UDirection, VDirection, Frame
box_5 = CenterBox(Base=evalsrf.Frame, X=1, Y=1, Z=1)
split_2 = SplitBrep(Brep=srfgrid_2, Cutter=box_5)
item_4 = ListItem(List=split_2, Index=0, Wrap=True)

brep_2 = Brep(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)
pt_10 = Point(Point(0.6442965029, -0.01086970551, 0))
pt_11 = Point([Point(6.933961729, -3.869629055, 0), Point(1.136003693, -4.208899822, 0), Point(-1.896360791, 0.3341178344, 0), Point(1.091799117, 4.477686545, 0), Point(5.849853553, 4.470350256, 0), Point(6.017103486, -0.02678989034, 0)])
bbox = BoundingBox(Content=brep_2, Plane=PlaneXY(0, 0, 0))  # -> Box, Box_2
pline_2 = PolyLine(Vertices=pt_11, Closed=invert(False))
pt_12 = Point(Point(20.57298753, 0, 0))
box_6 = CenterBox(Base=pt_10, X=1, Y=1, Z=1)
boxprop = BoxProperties(Box=bbox.Box)  # -> Center, Diagonal, Area, Volume, Degeneracy
cir = Circle(Plane=pt_12, Radius=Slider(5, range=0..10))
pt_13 = Point(Point(1, 1, 1))
pt_14 = Point(Point(0, 0, 0))
split_3 = SplitBrep(Brep=join.Breps, Cutter=box_6)
srfsplit_2 = SurfaceSplit(Surface=srf4pt, Curves=pline_2)
box_7 = Box2Pt(PointA=pt_14, PointB=pt_13, Plane=PlaneXY(0, 0, 0))
srfsplit_3 = SurfaceSplit(Surface=srf4pt_2, Curves=cir)
neg = Negative(Value=boxprop.Center)
move_2 = Move(Geometry=brep_2, Motion=neg)  # -> Geometry, Transform
item_5 = ListItem(List=srfsplit_2, Index=0, Wrap=True)  # -> Item, Item1
item_6 = ListItem(List=split_3, Index=0, Wrap=True)
item_7 = ListItem(List=srfsplit_3, Index=0, Wrap=True)  # -> Item, Item1
brep_3 = Brep(box_7)
brep_4 = Brep([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])
edges_2 = BrepEdges(Brep=item_2.Item)  # -> Naked, Interior, NonManifold
scale = Scale(Geometry=move_2.Geometry, Center=Point(0, 0, 0), Factor=Slider(5, range=0..10))  # -> Geometry, Transform
python = GhPythonScript(brep=scale.Geometry)  # -> out, curves2d, curves3d, surfaces, edges, faces, a, brep; inputs brep: Brep
# ---------- python: Python ----------
import Rhino.Geometry as rg

curves3d = brep.Curves3D
curves2d = brep.Curves2D
edges = map(lambda t:  t.EdgeCurve.Trim(t.Domain), brep.Edges)
surfaces = brep.Surfaces
faces = brep.Faces
# ---------- end python ----------
item_8 = ListItem(List=edges_2.Naked, Index=0, Wrap=True)
c_script = CSharpScript(x=item_2.Item1)  # -> out, A; inputs x: Brep
# ---------- c_script: C# ----------
    x.Repair(0.0001);
    A = x;
# ---------- end c_script ----------
entwine = Entwine(Branch00=python.curves3d, Branch01=python.edges, FlattenInputs=True)
crv = Curve(python.curves2d)
item_9 = ListItem(List=python.curves3d, Index=Slider(3, range=0..10), Wrap=True)
data = Data(shatter)
cp = ControlPoints(Curve=item_8)  # -> Points, Weights, Knots
eval = EvaluateCurve(Curve=reparameterize(python.curves3d), Parameter=".5")  # -> Point, Tangent, Angle
to_speckle = ToSpeckle(Objects=scale.Geometry)
data_2 = Data()
vdisex = VectorDisplayEx(Point=eval.Point, Vector=eval.Tangent, Colour=RGB(0, 0, 0), Width=2)
to_native = ToNative(SpeckleObjects=to_speckle)
number_slider_5 = Slider(4, range=0..4)
edges_3 = BrepEdges(Brep=sdiff_5)  # -> Naked, Interior, NonManifold
eso = ExpandSpeckleObject(SpeckleObject=to_speckle)  # -> Area, Bbox, Curve2D, Curve2DValues, Curve3D, Curve3DValues, DisplayMesh, Edges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
brep_5 = Brep(to_native)
panel_2 = Panel("""Cube
CubeWithHole
Complex
FaceWithHole
TrimmedFace
TrimmedFaceSingleLoop
TwoFaces
TwoFacesWithHole
QuadDome
NurbsWithHole
FaceWithTrimmedEdge""")
brep_6 = Brep(python.brep)
split_4 = SplitList(List=edges_3.Interior, Index=Slider(56, range=0..100))  # -> ListA, ListB
panel_3 = Panel(edges_3.Interior)
c_script_2 = CSharpScript(x=brep_6)  # -> out, A; inputs x: Brep
# ---------- c_script_2: C# ----------
    BrepFace f = x.Faces[0];
    f.RebuildEdges(0.00, false, false);
    A = x;
# ---------- end c_script_2 ----------
entwine_2 = Entwine(
    Branch00=brep_3,
    Branch01=sdiff_3,
    Branch02=sdiff_5,
    Branch03=item_7.Item,
    Branch04=item_2.Item1,
    Branch05=item_7.Item1,
    Branch06=join.Breps,
    Branch07=item_6,
    Branch08=join_2.Breps,
    Branch09=item_2.Item,
    Branch010=c_script_2.A,
    FlattenInputs=True)
crv_2 = Curve(eso.Curve2D)
item_10 = ListItem(List=split_4.ListB, Index=Slider(13, range=0..15), Wrap=True)
pt_15 = Point(eso.Provenance)
concat = Concatenate(FragmentA="Brep-", FragmentB=panel_2)  # -> graft(Result)
eso_2 = ExpandSpeckleObject(SpeckleObject=eso.Curve3DValues)  # -> Brep, Curve, Curve3dIndex, Domain, EndIndex, EndVertex, ProxyCurveIsReversed, StartIndex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
to_speckle_2 = ToSpeckle(Objects=sdiff_3)
end = EndPoints(Curve=graft(eso.Curve2D))  # -> Start, End
item_11 = ListItem(List=python.curves3d, Index=number_slider_5, Wrap=True)
item_12 = ListItem(List=crv_2, Index=number_slider_5, Wrap=True)
c_script_3 = CSharpScript(x=item_10)  # -> out, A, B, C; inputs x: Curve
# ---------- c_script_3: C# ----------
    var n = x.ToNurbsCurve();
    B = x.Rebuild(n.Points.Count, n.Degree, true);
    var c = x.Fit(n.Degree, 0.000001, 0.000001);
    //n.Knots.RemoveMultipleKnots(0, n.Degree + 1, 0);

    C = c;
    A = n;
    for(var i = n.Degree; i < n.Knots.Count - n.Degree; i++){
      var mult = n.Knots.KnotMultiplicity(i);
      i += mult - 1;
      Print(mult.ToString());
    }
# ---------- end c_script_3 ----------
cp_2 = ControlPoints(Curve=item_10)  # -> Points, Weights, Knots
knots = KnotVector(Count=Slider(3, range=0..10), Degree=Slider(2, range=0..10), Periodic=False)
eso_3 = ExpandSpeckleObject(SpeckleObject=eso_2.Curve3dIndex)  # -> Brep, Face, FaceIndex, TrimIndices, Trims, Type
cp_3 = ControlPoints(Curve=c_script_3.B)  # -> Points, Weights, Knots
eso_4 = ExpandSpeckleObject(SpeckleObject=to_speckle_2)  # -> Area, Bbox, Curve2D, Curve2DValues, Curve3D, Curve3DValues, DisplayMesh, Edges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
panel_4 = Panel(c_script_3.out)
lng = ListLength(List=cp_3.Points)
eso_5 = ExpandSpeckleObject(SpeckleObject=eso_3.Trims)  # -> Brep, Curve2d, CurveIndex, Domain, Edge, EdgeIndex, EndIndex, Face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

brep_7 = Brep(flatten(entwine_2))
item_13 = ListItem(List=brep_7, Index=Slider(9, range=0..10), Wrap=True)
bbox_2 = BoundingBox(Content=brep_7, Plane=PlaneXY(0, 0, 0))  # -> Box, Box_2
boxprop_2 = BoxProperties(Box=bbox_2.Box)  # -> Center, Diagonal, Area, Volume, Degeneracy
area = Area(Geometry=bbox_2.Box)  # -> Area, Centroid
volume = Volume(Geometry=bbox_2.Box)  # -> Volume, Centroid
vlen = VectorLength(Vector=boxprop_2.Diagonal)
division = Division(A="10", B=vlen)
scale_2 = Scale(Geometry=brep_7, Center=Point(0, 0, 0), Factor=division)  # -> Geometry, Transform
bbox_3 = BoundingBox(Content=scale_2.Geometry, Plane=PlaneXY(0, 0, 0))  # -> Box, Box_2
boxprop_3 = BoxProperties(Box=bbox_3.Box_2)  # -> Center, Diagonal, Area, Volume, Degeneracy
debox = DeconstructBox(Box=bbox_3.Box)  # -> Plane, X, Y, Z
num = Number(debox.X)
num_2 = Number(debox.Y)
bnd = Bounds(Numbers=num)
bnd_2 = Bounds(Numbers=num_2)
dedomain = DeconstructDomain(Domain=bnd)  # -> Start, End
dedomain_2 = DeconstructDomain(Domain=bnd_2)  # -> Start, End
series = Series(Start=0, Step=dedomain.End, Count="4")
series_2 = Series(Start=0, Step=dedomain_2.End, Count="4")
pt_16 = ConstructPoint(XCoordinate=graft(series), YCoordinate=series_2, ZCoordinate=0)  # -> flatten(Point)
short = ShortestList(ListA=pt_16, ListB=scale_2.Geometry, TrimMode=2)  # -> ListA, ListB
vec2pt = Vector2Pt(PointA=boxprop_3.Center, PointB=short.ListA, Unitize=False)  # -> Vector, Length
move_3 = Move(Geometry=short.ListB, Motion=vec2pt.Vector)  # -> graft(Geometry), Transform

to_speckle_3 = ToSpeckle(Objects=move_3.Geometry)
srl = Serialize(O=to_speckle_3)

to_native_2 = ToNative(SpeckleObjects=to_speckle_3)
panel_5 = Panel(lng)
panel_6 = Panel(cp_3.Knots)
brep_8 = Brep(to_native_2)
eso_6 = ExpandSpeckleObject(SpeckleObject=eso_5.Edge)  # -> Brep, Curve, Curve3dIndex, Domain, EndIndex, EndVertex, ProxyCurveIsReversed, StartIndex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
crv_3 = Curve(flatten(eso_6.Curve))
item_14 = ListItem(List=crv_3, Index=number_slider_5, Wrap=True)
weld = WeldMesh(Mesh=eso_4.DisplayMesh, Angle=3.141592654)
geo = Geometry(eso_4.Curve2D)
path = FilePath("Y:\Documents\Speckle\speckle-sharp\Objects\Converters\ConverterRevit\TestModels\")
flatten = FlattenTree(Tree=to_speckle_3, Path="{0}")
flip_2 = MeshFlip(Mesh=weld)
panel_7 = Panel([eso_6.StartIndex, eso_6.EndIndex])
c_script_4 = CSharpScript(contents=srl, folderPath=path, fileName=concat)  # -> A; inputs contents: String, folderPath: String, fileName: String
# ---------- c_script_4: C# ----------
    System.IO.File.WriteAllText(folderPath + fileName + ".json", contents);
# ---------- end c_script_4 ----------
panel_8 = Panel(brep_8)
number_slider_6 = Slider(4, range=0..10)

brep_9 = Brep(python.brep)  # disabled
debrep = DeconstructBrep(Brep=brep_9)  # -> Faces, Edges, Vertices; disabled
pt_17 = Point(Point(0.5, 0.5, 0))  # disabled
evalsrf_2 = EvaluateSurface(Surface=reparameterize(debrep.Faces), Point=pt_17)  # -> flatten(Point), Normal, UDirection, VDirection, Frame; disabled
curvepoint = PointOnCurve(debrep.Edges, parameter=0.5)  # disabled
end_2 = EndPoints(Curve=debrep.Edges)  # -> Start, End; disabled
subtraction = Subtraction(A=end_2.End, B=end_2.Start)  # disabled
lng_2 = ListLength(List=evalsrf_2.Point)  # disabled
lng_3 = ListLength(List=curvepoint)  # disabled
swatch = ColourSwatch(SwatchColor=RGB(0, 0, 0))  # disabled
swatch_2 = ColourSwatch(SwatchColor=RGB(0, 80, 199))  # disabled
series_3 = Series(Start=0, Step=1, Count=lng_2)  # disabled
series_4 = Series(Start=0, Step=1, Count=lng_3)  # disabled
tag = TextTag(Location=curvepoint, Text=series_4, Colour=swatch_2)  # disabled
vdis = VectorDisplay(Anchor=end_2.Start, Vector=subtraction)  # disabled
tag_2 = TextTag(Location=evalsrf_2.Point, Text=series_3, Colour=swatch)  # disabled

pt_18 = Point([Point(-6.801964762, -4.793113776, 6.064103075), Point(-6.71707748, 9.964966405, 0), Point(9.567200842, 9.209756521, 3.836280563), Point(7.916250609, -5.094432938, 0)])

# ---- group: Serialize/Deserialize
to_speckle_4 = ToSpeckle(Objects=python.brep)  # disabled
srl_2 = Serialize(O=to_speckle_4)  # disabled
deserialize = Deserialize(O=srl_2)  # disabled
to_native_3 = ToNative(Objects=deserialize)  # disabled
brep_10 = Brep(to_native_3)  # disabled
swatch_3 = ColourSwatch(SwatchColor=RGB(181, 228, 255))  # disabled
preview_2 = CustomPreview(Geometry=brep_10, Material=swatch_3)  # disabled

# ----
item_15 = ListItem(List=pt_18, Index=0, Wrap=True)  # -> Item, Item1, Item2, Item3
series_5 = Series(Start=0, Step=1, Count=number_slider_6)
srf4pt_4 = _4PointSurface(CornerA=item_15.Item, CornerB=item_15.Item1, CornerC=item_15.Item2, CornerD=item_15.Item3)
pt_19 = Point(Point(0.5, 0.5, 0))
pt_20 = ConstructPoint(XCoordinate=graft(series_5), YCoordinate=series_5, ZCoordinate=0)
pt_21 = Point(Tree({0;0;0}: [Point(0, 0, 0), Point(0, 1, 0), Point(0, 2, 0), Point(0, 3, 0)], {0;0;1}: [Point(1, 0, 0), Point(1, 1, 1.378930523), Point(1, 2, 0), Point(1, 3, 0)], {0;0;2}: [Point(2, 0, 0), Point(2, 1, 0), Point(2, 2, 0), Point(2, 3, 0)], {0;0;3}: [Point(3, 0, 0), Point(3, 1, 0), Point(3, 2, 0), Point(3, 3, 0)]))
srfgrid_3 = SurfaceFromPoints(Points=flatten(pt_21), UCount=number_slider_6, Interpolate=invert(False))
evalsrf_3 = EvaluateSurface(Surface=reparameterize(srfgrid_3), Point=pt_19)  # -> Point, Normal, UDirection, VDirection, Frame
box_8 = CenterBox(Base=evalsrf_3.Point, X=1, Y=1, Z=1)
sdiff_6 = SolidDifference(BrepsA=srfgrid_3, BrepsB=box_8)
split_5 = SplitBrep(Brep=srfgrid_3, Cutter=box_8)
item_16 = ListItem(List=split_5, Index=0, Wrap=True)
brep_11 = Brep(sunion)
panel_9 = Panel(brep_10)  # disabled
to_speckle_5 = ToSpeckle(Objects=sunion)
srl_3 = Serialize(O=to_speckle_5)
eso_7 = ExpandSpeckleObject(SpeckleObject=to_speckle_4)  # -> Area, Curve2D, Curve3D, DisplayValue, Edges, Faces, IsClosed, Loops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; disabled
c_script_5 = CSharpScript(contents=srl_3, folderPath=path, fileName="Brep-SimpleHyparHole")  # -> A; inputs contents: String, folderPath: String, fileName: String; same code as c_script_4
panel_10 = Panel("https://latest.speckle.dev/streams/cdf2ebe2e2/branches/1%20standard")
eso_8 = ExpandSpeckleObject(SpeckleObject=eso_7.Edges)  # -> Brep, Curve, Curve3dIndex, Domain, EndIndex, EndVertex, ProxyCurveIsReversed, StartIndex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; disabled
eso_9 = ExpandSpeckleObject(SpeckleObject=eso_7.Loops)  # -> Brep, Face, FaceIndex, TrimIndices, Trims, Type; disabled
eso_10 = ExpandSpeckleObject(SpeckleObject=eso_9.Trims)  # -> Brep, Curve2d, CurveIndex, Domain, Edge, EdgeIndex, EndIndex, Face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; disabled
domain = Domain(flatten(eso_8.Domain))  # disabled
domain_2 = Domain(flatten(eso_8.Curve))  # disabled
geo_2 = Geometry(graft(<brep referenced from the Rhino model>))
panel_11 = Panel(domain_2)  # disabled
panel_12 = Panel(eso_10.IsReversed)  # disabled
to_speckle_6 = ToSpeckle(Data=geo_2)
send = Send(
    Data=flatten(geo_2),
    Stream=panel_10,
    AutoSend=False,
    BaseId="5030b5567426739884dc1d27b889b818",
    CurrentComponentState="up_to_date",
    KitName="Objects",
    OutputWrappers="https://latest.speckle.dev\tcdf2ebe2e2\tcc37a8de2d",
    UseDefaultCache=True)
eso_11 = ExpandSpeckleObject(SpeckleObject=to_speckle_6)  # -> Area, Bbox, Curve2D, Curve2DValues, Curve3D, Curve3DValues, DisplayMesh, Edges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
to_native_4 = ToNative(Base=to_speckle_6)
eso_12 = ExpandSpeckleObject(SpeckleObject=eso_11.Loops)  # -> Brep, Face, FaceIndex, TrimIndices, Trims, Type
eso_13 = ExpandSpeckleObject(SpeckleObject=eso_12.Trims)  # -> Brep, Curve2d, CurveIndex, Domain, Edge, EdgeIndex, EndIndex, Face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
