# Grasshopper definition ComplexBrep.ghx (Grasshopper 1.0.7)
# plug-ins: Speckle 2

list = Accounts(
    {"Account (alan@rynne.es | https://staging.speckle.dev)": "ead7b5bb692081ceb2ed3cde2b088187", "Account (alan@rynne.es | http://localhost:3000)": "c17e3b5af2f177869a733cca10850355", "Account (alan@speckle.systems | https://staging.speckle.dev)": "4f3b8d2197550b86f070c641aebd21a8"}, selected="Account (alan@speckle.systems | https://staging.speckle.dev)",
    selectedId="4f3b8d2197550b86f070c641aebd21a8",
    selectedServer="https://staging.speckle.dev")
list_2 = Accounts(
    {"Account (alan@rynne.es | https://staging.speckle.dev)": "ead7b5bb692081ceb2ed3cde2b088187", "Account (alan@rynne.es | http://localhost:3000)": "c17e3b5af2f177869a733cca10850355", "Account (alan@speckle.systems | https://staging.speckle.dev)": "4f3b8d2197550b86f070c641aebd21a8"}, selected="Account (alan@speckle.systems | https://staging.speckle.dev)",
    selectedId="4f3b8d2197550b86f070c641aebd21a8",
    selectedServer="https://staging.speckle.dev")
brep = Brep([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])
join = BrepJoin(Breps=brep)  # -> Breps, Closed
bbox = BoundingBox(Content=brep, Plane=PlaneXY(0, 0, 0))  # -> Box, Box_2
volume = Volume(Geometry=bbox.Box)  # -> Volume, Centroid
item = ListItem(List=brep, Index=Slider(3, range=0..157), Wrap=True)
id_0f0a57f547 = CreateStream(Account=list, stream="0f0a57f547 https://staging.speckle.dev 4f3b8d2197550b86f070c641aebd21a8")
brep_2 = Brep(item)
to_speckle = ToSpeckle(Objects=brep, KitName="Objects")
sort = SortList(Keys=volume.Volume, ValuesA=brep)  # -> Keys, reverse(ValuesA)
send = Send(
    Data=brep,
    Stream=id_0f0a57f547,
    Branch="main",
    AutoSend=False,
    BaseId="a5748458ffb96022f38a0961c8380ced",
    CurrentComponentState="up_to_date",
    KitName="Objects",
    OutputWrappers="https://staging.speckle.dev\t0f0a57f547\t976051a158",
    UseDefaultCache=True)
srl = Serialize(SpeckleObject=to_speckle)
receive = Receive(
    Stream=send,
    AutoReceive=False,
    CurrentComponentState="up_to_date",
    KitName="Objects",
    LastInfoMessage="Alan Rynne @ 2020-12-11T07:57:28.224Z: Grasshopper push. (id:976051a158)",
    ReceivedObjectId="a5748458ffb96022f38a0961c8380ced",
    StreamWrapper="https://staging.speckle.dev/streams/0f0a57f547/commits/976051a158?u=4f3b8d2197550b86f070c641aebd21a8")  # -> Data, Info
item_2 = ListItem(List=sort.ValuesA, Index=Slider(15, range=0..157), Wrap=True)
to_speckle_2 = ToSpeckle(Objects=item_2, KitName="Objects")
srl_2 = Serialize(SpeckleObject=to_speckle_2)
mesh = Mesh(brep)
join_2 = TextJoin(Text=srl_2, Join=",")
deserialize = Deserialize(S=srl_2)
brep_3 = Brep(receive.Data)
deserialize_2 = Deserialize(S=srl)
concat = Concatenate(FragmentA="[", FragmentB=join_2, FragmentC="]")
to_native = ToNative(SpeckleObjects=deserialize, KitName="Objects")
to_native_2 = ToNative(SpeckleObjects=deserialize_2, KitName="Objects")
sget = StreamGet(StreamID="0f0a57f547", Account=list_2)
panel = Panel(brep_3)
brep_4 = Brep(to_native)
brep_5 = Brep(to_native_2)
path = FilePath("Y:\Documents\Speckle\speckle-sharp\Objects\Converters\ConverterRevit\TestModels\")
c_script = CSharpScript(contents=srl_2, folderPath=path, fileName="Brep-Boat")  # -> A; inputs contents: String, folderPath: String, fileName: String
# ---------- c_script: C# ----------
    System.IO.File.WriteAllText(folderPath + fileName + ".json", contents);
# ---------- end c_script ----------
bbox_2 = BoundingBox(Content=brep_4, Plane=PlaneXY(0, 0, 0))  # -> Box, Box_2
bbox_3 = BoundingBox(Content=brep_5, Plane=PlaneXY(0, 0, 0), UnionBox=True)  # -> Box, Box_2
send_2 = Send(
    Data=mesh,
    Stream=sget,
    Branch="main",
    AutoSend=False,
    BaseId="87d9cfa8ca556798738f49731c8d652d",
    CurrentComponentState="up_to_date",
    KitName="Objects",
    OutputWrappers="https://staging.speckle.dev\t0f0a57f547\tdb567ab9fb",
    UseDefaultCache=True)
debox = DeconstructBox(Box=bbox_2.Box)  # -> Plane, X, Y, Z
debox_2 = DeconstructBox(Box=bbox_3.Box)  # -> Plane, X, Y, Z
eso = ExpandSpeckleObject(SpeckleObject=to_speckle_2)  # -> Area, Curve2D, Curve3D, DisplayValue, Edges, Faces, IsClosed, Loops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
num = Number(debox_2.X)
num_2 = Number(debox.X)
dedomain = DeconstructDomain(Domain=debox.X)  # -> Start, End
multiplication = Multiplication(A=num, B=Slider(1.1, range=0..10))
eso_2 = ExpandSpeckleObject(SpeckleObject=eso.Edges)  # -> Brep, Curve, Curve3dIndex, Domain, EndIndex, EndVertex, ProxyCurveIsReversed, StartIndex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
X = UnitX(Factor=multiplication)
subtraction = Subtraction(A=num_2, B=dedomain.Start)
X_2 = UnitX(Factor=num_2)
neg = Negative(Value=X)
move = Move(Geometry=brep_4, Motion=neg)  # -> Geometry, Transform
domain = Domain(eso_2.Curve)
domain_2 = Domain(eso_2.Domain)
move_2 = Move(Geometry=brep_5, Motion=X)  # -> Geometry, Transform
equals = Equality(FirstNumber=domain, SecondNumber=domain_2)  # -> Equality, Inequality
preview = CustomPreview(
    Geometry=move.Geometry,
    Material={diffuse=RGB(221, 160, 221), emission=RGB(66, 48, 66), shine=0.5, specular=RGB(255, 255, 255), transparency=0})
preview_2 = CustomPreview(Geometry=brep, Material=ColourSwatch(SwatchColor=RGB(255, 255, 255)))
preview_3 = CustomPreview(Geometry=move_2.Geometry, Material=ColourSwatch(SwatchColor=RGB(0, 140, 255)))
panel_2 = Panel(equals.Equality)
