# Grasshopper definition ReceiveCrash-A.ghx (Grasshopper 1.0.7)
# plug-ins: Speckle 2

list = Accounts(
    {"No account selected": , "Account (alan@speckle.systems | https://speckle.xyz)": "6718249256", "Account (alan@speckle.systems | https://latest.speckle.dev)": "9d75ae839d"}, selected="Account (alan@speckle.systems | https://latest.speckle.dev)",
    selectedId="9d75ae839d",
    selectedServer="https://latest.speckle.dev")
series = Series(Start=0, Step=1, Count=Slider(15, range=0..100))
pt = ConstructPoint(XCoordinate=graft(series), YCoordinate=series, ZCoordinate=0)
sph = Sphere(Base=pt, Radius=Slider(0.4, range=0..1))
id_bde8129a6b = CreateStream(Account=list, stream="bde8129a6b https://latest.speckle.dev 9d75ae839d")
send = Send(
    Data=sph,
    Stream=id_bde8129a6b,
    AutoSend=False,
    BaseId="66847f53cca601117d40a35031981e85",
    CurrentComponentState="expired",
    KitName="Objects",
    OutputWrappers="https://latest.speckle.dev\tbde8129a6b\t102dffb032",
    UseDefaultCache=False)
panel = Panel(id_bde8129a6b)
