# Grasshopper definition RecursiveConversionTests.ghx (Grasshopper 1.0.7)
# plug-ins: Speckle 2

cir = Circle(Plane=PlaneXY(0, 0, 0), Radius=1)
panel = Panel("adfadfa")
cso = CreateSpeckleObject(A=Slider(2, range=0..10), B=cir)
cso_2 = CreateSpeckleObject(A=cso, B=cir)
cso_3 = CreateSpeckleObject(A=cso_2, B=cir)

to_speckle = ToSpeckle(Data="adfa")
to_native = ToNative(Base=to_speckle)
panel_2 = Panel(to_native)

# ---- group: Pass through when expanding
eso = ExpandSpeckleObject(SpeckleObject=cso_3)  # -> A, B

# ---- group: Send and receive nested non-converted objects
panel_3 = Panel("https://speckle.xyz/streams/b709b3e527")
receive = Receive(
    Stream=panel_3,
    AutoReceive=False,
    CurrentComponentState="up_to_date",
    KitName="Objects",
    LastInfoMessage="Alan Rynne @ 2021-05-04T09:01:47.867Z: Pushed 7 elements from Grasshopper. (id:f3e0974cf1)",
    ReceivedCommitId="f3e0974cf1",
    ReceivedObjectId="1badc17e0521ed13fa0e022cf1266f95",
    StreamWrapper="https://speckle.xyz/streams/b709b3e527")  # -> Data, Info

# ----
to_native_2 = ToNative(Base=receive.Data)

# ---- group: Convert recursive
to_speckle_2 = ToSpeckle(Data=cso_3)
to_native_3 = ToNative(Base=to_speckle_2)
python = GhPythonScript(x=to_native_2)  # -> out, a, b
# ---------- python: Python ----------
a = x["@A"]
b = x["@B"]
# ---------- end python ----------
python_2 = GhPythonScript(x=python.a)  # -> out, a, b; same code as python
python_3 = GhPythonScript(x=python_2.a)  # -> out, a, b; same code as python

# ---- group: Send and receive nested non-converted objects (continued)
send = Send(
    Data=to_native_3,
    Stream=panel_3,
    AutoSend=False,
    BaseId="1badc17e0521ed13fa0e022cf1266f95",
    CurrentComponentState="up_to_date",
    KitName="Objects",
    OutputWrappers="https://speckle.xyz\tb709b3e527\tf3e0974cf1",
    UseDefaultCache=True)
