# Grasshopper definition SurfaceTests.ghx (Grasshopper 1.0.7)
# plug-ins: Speckle 2

number_slider = Slider(4, range=0..10)
number_slider_2 = Slider(10, range=0..10)
accounts = Accounts(
    {"Account (alan@rynne.es | https://staging.speckle.dev)": "ead7b5bb692081ceb2ed3cde2b088187", "Account (alan@rynne.es | http://localhost:3000)": "c17e3b5af2f177869a733cca10850355", "Account (alan@speckle.systems | https://staging.speckle.dev)": "4f3b8d2197550b86f070c641aebd21a8"}, selected="Account (alan@rynne.es | http://localhost:3000)",
    selectedId="c17e3b5af2f177869a733cca10850355",
    selectedServer="http://localhost:3000")
accounts_2 = Accounts(
    {"Account (alan@rynne.es | https://staging.speckle.dev)": "ead7b5bb692081ceb2ed3cde2b088187", "Account (alan@rynne.es | http://localhost:3000)": "c17e3b5af2f177869a733cca10850355", "Account (alan@speckle.systems | https://staging.speckle.dev)": "4f3b8d2197550b86f070c641aebd21a8"}, selected="Account (alan@rynne.es | https://staging.speckle.dev)",
    selectedId="ead7b5bb692081ceb2ed3cde2b088187",
    selectedServer="https://staging.speckle.dev")
random = Random(Range=Domain(0, 1), Number=number_slider, Seed=2)
series = Series(Start=0, Step=1, Count=number_slider)
series_2 = Series(Start=0, Step=1, Count=number_slider_2)
construct_point = ConstructPoint(XCoordinate=graft(series_2), YCoordinate=series, ZCoordinate=random)
point = Point(Tree({0;0;0}: [Point(0, 0, -0.3335912587), Point(0, 1, 0), Point(0, 2, 0.02729024476), Point(0, 3, 1.017739202)], {0;0;1}: [Point(1, 0, -1.743763853), Point(1, 1, -1.312690109), Point(1, 2, 0.5953135809), Point(1, 3, -0.3580883641)], {0;0;2}: [Point(2, 0, 0), Point(2, 1, 0.8522849393), Point(2, 2, 1.025294899), Point(2, 3, -0.7850691057)], {0;0;3}: [Point(3, 0, 0.7360832942), Point(3, 1, 0.7047015129), Point(3, 2, -0.1658937351), Point(3, 3, -0.1525213286)]))
surface_from_points = SurfaceFromPoints(Points=flatten(construct_point), UCount=number_slider_2, Interpolate=False)
custom_preview = CustomPreview(Geometry=surface_from_points, Material=ColourSwatch(SwatchColor=RGB(0, 166, 255)))
id_cc631d854e = CreateStream(Account=accounts, stream="cc631d854e http://localhost:3000 c17e3b5af2f177869a733cca10850355")
create_speckle_object = CreateSpeckleObject(A=surface_from_points)
id_7ed7a7d55e = CreateStream(Account=accounts_2, stream="7ed7a7d55e https://staging.speckle.dev ead7b5bb692081ceb2ed3cde2b088187")

create_speckle_object_2 = CreateSpeckleObject(A=surface_from_points)  # disabled
serialize = Serialize(O=create_speckle_object_2)  # disabled
deserialize = Deserialize(O=serialize)  # disabled
expand_speckle_object = ExpandSpeckleObject(SpeckleObject=create_speckle_object_2)  # disabled
expand_speckle_object_2 = ExpandSpeckleObject(SpeckleObject=deserialize)  # disabled
panel = Panel(expand_speckle_object)  # disabled
panel_2 = Panel(expand_speckle_object_2)  # disabled
surface = Surface(expand_speckle_object)  # disabled
surface_2 = Surface(expand_speckle_object_2)  # disabled

send = Send(
    Data=create_speckle_object,
    Stream=id_cc631d854e,
    Branch="main",
    AutoSend=True,
    BaseId="b7c41a1466bf458da7bdd365ed356863",
    CurrentComponentState="up_to_date",
    KitName="Objects",
    OutputWrappers="http://localhost:3000\tcc631d854e\td10286a96e",
    UseDefaultCache=False)  # -> Commits, ObjectId, Data
receive = Receive(
    Stream=id_cc631d854e,
    AutoReceive=True,
    CurrentComponentState="up_to_date",
    KitName="Objects",
    LastInfoMessage="Alan Rynne @ 2020-11-06T14:02:33.635Z: Grasshopper push. (id:d10286a96e)",
    ReceivedObjectId="b7c41a1466bf458da7bdd365ed356863",
    StreamWrapper="http://localhost:3000/streams/cc631d854e?u=c17e3b5af2f177869a733cca10850355")  # -> Data, Info

# ---- group: Conversion Nodes
to_speckle = ToSpeckle(Objects=surface_from_points, KitName="Objects")  # disabled
serialize_2 = Serialize(O=to_speckle)  # disabled
deserialize_2 = Deserialize(O=serialize_2)  # disabled
to_native = ToNative(Objects=to_speckle, KitName="Objects")  # disabled
to_native_2 = ToNative(Objects=deserialize_2, KitName="Objects")  # disabled
panel_3 = Panel(to_native)  # disabled
panel_4 = Panel(to_native_2)  # disabled
surface_3 = Surface(to_native)  # disabled
surface_4 = Surface(to_native_2)  # disabled

# ----
expand_speckle_object_3 = ExpandSpeckleObject(SpeckleObject=receive.Data)
serialize_3 = Serialize(O=send.Data)
panel_5 = Panel(serialize_3)
surface_5 = Surface(expand_speckle_object_3)
panel_6 = Panel(expand_speckle_object_3)
surface_points = SurfacePoints(Surface=surface_5)  # -> Points, Weights, Greville, UCount, VCount
