# Grasshopper definition TaskCapableObjectManagement.ghx (Grasshopper 1.0.7)
# plug-ins: Speckle 2, Bifocals

series = Series(Start=0, Step=1, Count=10)
series_2 = Series(Start=0, Step=1, Count=10)
sph = Sphere(Base=PlaneXY(0, 0, 0), Radius=series)
box = CenterBox(Base=PlaneXY(0, 0, 0), X=1, Y=1, Z=1)
addition = Addition(A=series_2, B=1)
panel = Panel("B")
cso = CreateSpeckleObject(Sphere=sph, Box=box, selectedKitName="Objects")
panel_2 = Panel("C")
panel_3 = Panel("""A
B
C""")
panel_4 = Panel("""D
E
F""")
msphereex = MeshSphereEx(Base=PlaneXY(0, 0, 0), Radius=10, Count=5)
series_3 = Series(Start=0, Step=1, Count=10)
entwine = Entwine(Branch00=reverse(series_2), Branch01=series_2, Branch02=addition, FlattenInputs=True)
entwine_2 = Entwine(Branch0X=panel_3, Branch1X=panel_4, FlattenInputs=False)
sph_2 = Sphere(Base=PlaneXY(0, 0, 0), Radius=1)
eso = ExtendSpeckleObject(SpeckleObject=cso, A=msphereex, B=series_3, selectedKitName="Objects")
eso_k_v = ExtendSpeckleObjectByKeyValue(SpeckleObject=cso, Keys="@A", Values=msphereex, UseTasks=True, selectedKitName="Objects")
eso_k_v_2 = ExtendSpeckleObjectByKeyValue(SpeckleObject=cso, Keys="@A", Values=msphereex, selectedKitName="Objects")
eso_2 = ExpandSpeckleObject(SpeckleObject=cso, selectedKitName="Objects")  # -> Box, Sphere
tcso = TCCreateSpeckleObject(Sphere=sph_2, selectedKitName="Objects")
entwine_3 = Entwine(FlattenInputs=False)
create_speckle_object_by_key_value = CreateSpeckleObjectByKeyValue(Keys=entwine_2, Values=entwine, selectedKitName="Objects")
eso_3 = ExpandSpeckleObject(SpeckleObject=eso, selectedKitName="Objects")  # -> A, B, Box, Sphere
eso_4 = ExpandSpeckleObject(SpeckleObject=eso_k_v, selectedKitName="Objects")  # -> A, Box, Sphere
object_k_v = SpeckleObjectValueByKey(Object=cso, Key="box", selectedKitName="Objects")
eso_5 = ExpandSpeckleObject(SpeckleObject=tcso, selectedKitName="Objects")
eso_6 = ExpandSpeckleObject(SpeckleObject=create_speckle_object_by_key_value, selectedKitName="Objects")  # -> A, B, C, D, E, F
panel_5 = Panel(eso_5)
panel_6 = Panel(eso_4.A)
panel_7 = Panel(eso_6.F)
