# Grasshopper definition CreateSpeckleObjectTests-WithGeometry.ghx (Grasshopper 1.0.7)
# plug-ins: Speckle 2

list = Accounts(
    {"Account (55cb622@acme.com | http://127.0.0.1:3000)": "10e5c42cba7f3450b4271a97feb45ea6", "Account (ebccc58@acme.com | http://127.0.0.1:3000)": "17cef6e0b30b1a41e99b81f85f1ae286", "Account (2bb3e2f@acme.com | http://127.0.0.1:3000)": "1d4eb84e13b02ded939f7f20b7af1085", "Account (d5fbf5c@acme.com | http://127.0.0.1:3000)": "2268457157f8f0b2f4db8b9b715dfc5b", "Account (58dbf8f@acme.com | http://127.0.0.1:3000)": "231748c2709d8364288b671b84a2892b", "Account (3b54451@acme.com | http://127.0.0.1:3000)": "235f3e6bc852092419eb3877130f14b0"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}, selected="Account (d05dbd8@acme.com | http://127.0.0.1:3000)": "4f3c8fe503b5b661b9cd3cc4f94711f7",
    selectedId="4f3c8fe503b5b661b9cd3cc4f94711f7",
    selectedServer="http://127.0.0.1:3000")
list_2 = Accounts(
    {"Account (55cb622@acme.com | http://127.0.0.1:3000)": "10e5c42cba7f3450b4271a97feb45ea6", "Account (ebccc58@acme.com | http://127.0.0.1:3000)": "17cef6e0b30b1a41e99b81f85f1ae286", "Account (2bb3e2f@acme.com | http://127.0.0.1:3000)": "1d4eb84e13b02ded939f7f20b7af1085", "Account (d5fbf5c@acme.com | http://127.0.0.1:3000)": "2268457157f8f0b2f4db8b9b715dfc5b", "Account (58dbf8f@acme.com | http://127.0.0.1:3000)": "231748c2709d8364288b671b84a2892b", "Account (3b54451@acme.com | http://127.0.0.1:3000)": "235f3e6bc852092419eb3877130f14b0"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}, selected="Account (d05dbd8@acme.com | http://127.0.0.1:3000)": "4f3c8fe503b5b661b9cd3cc4f94711f7",
    selectedId="4f3c8fe503b5b661b9cd3cc4f94711f7",
    selectedServer="http://127.0.0.1:3000")
series = Series(Start=0, Step=1, Count=Slider(3, range=0..10))
panel = Panel("""foo
bar
baz""")
lng = ListLength(List=panel)
msphere = MeshSphere(Base=PlaneXY(0, 0, 0), Radius=series, UCount=10, VCount=20)
pt = ConstructPoint(XCoordinate=0, YCoordinate=series, ZCoordinate=0)
vec = VectorXYZ(XComponent=0, YComponent=0, ZComponent=series)  # -> Vector, Length
sph = Sphere(Base=PlaneXY(0, 0, 0), Radius=series)
series_2 = Series(Start=0, Step=1, Count=lng)
sqlite = SqliteTransport(DatabaseName="Custom Speckle Sqlite Db")
pt_2 = ConstructPoint(XCoordinate=0, YCoordinate=series_2, ZCoordinate=0)
cso = CreateSpeckleObject(AbcDef=msphere)  # -> Debug, SpeckleObject
cso_2 = CreateSpeckleObject(Abc=[msphere, vec.Vector, pt], Def=sph)  # -> Debug, SpeckleObject
create_object_by_key_value = CreateObjectByKeyValue(Keys=panel, Values=pt_2)  # -> Object, Debug
send = Send(
    Data=cso.SpeckleObject,
    Branch="main",
    AutoSend=False,
    BaseId="cfb66774be39bfb2f913f97bdb55cba2",
    CurrentComponentState="sending",
    UseDefaultCache=True)  # -> Commits, ObjectId, Data
srl = Serialize(O=create_object_by_key_value.Object)
panel_2 = Panel(srl)
