# Grasshopper definition SenderReceiverConversionTests.gh (Grasshopper 1.0.7)
# plug-ins: Speckle 2

yz = YZPlane(Origin=Point(0, 0, 0))
cir = Circle(Plane=yz, Radius=1)
X = UnitX(Factor=1)
series = Series(Start=0.35, Step=1, Count=10)
series_2 = Series(Start=0, Step=1, Count=10)
series_3 = Series(Start=0.235, Step=1, Count=10)  # -> graft(Series)
cso = CreateSpeckleObject(A=X, B=yz, C=cir)
pt = ConstructPoint(XCoordinate=series, YCoordinate=0, ZCoordinate=0)  # -> graft(Point)
X_2 = UnitX(Factor=series)
yz_2 = YZPlane(Origin=X_2)
cir_2 = Circle(Plane=yz_2, Radius=1)

eso = ExpandSpeckleObject(SpeckleObject=cso)  # -> A, B, C
pt_2 = Point()
pln = Plane()
circle = Circle()

bool = Boolean(series_2)
item = ListItem(List=bool, Index=0, Wrap=True)
send = Send(
    Data=["HELLO ", "WORLD"],
    Stream="https://staging.speckle.dev/streams/f0f3a34460",
    Branch="strings",
    AutoSend=False,
    BaseId="a9e18d0b81bdf97ffa6f88c6b5aa3801",
    CurrentComponentState="up_to_date",
    KitName="Objects",
    OutputWrappers="https://staging.speckle.dev\tf0f3a34460\t22f9cca677",
    UseDefaultCache=True)  # -> Commits, ObjectId, Data
send_2 = Send(
    Data=bool,
    Stream="https://staging.speckle.dev/streams/f0f3a34460",
    Branch="booleans",
    AutoSend=False,
    BaseId="d2cc8c14b2c4cadca227237ee91f828b",
    CurrentComponentState="up_to_date",
    KitName="Objects",
    OutputWrappers="https://staging.speckle.dev\tf0f3a34460\t83a671d026",
    UseDefaultCache=True)  # -> Commits, ObjectId, Data
send_3 = Send(
    Data=series_3,
    Stream="https://staging.speckle.dev/streams/f0f3a34460",
    Branch="numbers",
    AutoSend=False,
    BaseId="63f70f699df04cdeaa6242da2d60fb31",
    CurrentComponentState="up_to_date",
    KitName="Objects",
    OutputWrappers="https://staging.speckle.dev\tf0f3a34460\tdfea28eaca",
    UseDefaultCache=True)  # -> Commits, ObjectId, Data
send_4 = Send(
    Data=cso,
    Stream="https://staging.speckle.dev/streams/f0f3a34460",
    Branch="main",
    AutoSend=False,
    BaseId="794eb07f85dace3fa1eea8e252aaf2af",
    CurrentComponentState="up_to_date",
    KitName="Objects",
    OutputWrappers="https://staging.speckle.dev\tf0f3a34460\t4280482899",
    UseDefaultCache=True)  # -> Commits, ObjectId, Data
send_5 = Send(
    Data=[cir_2, yz_2, X_2, pt],
    Stream="https://staging.speckle.dev/streams/f0f3a34460",
    Branch="main",
    AutoSend=False,
    BaseId="c6b656c4f3109f34554175c4cdc20e3f",
    CurrentComponentState="up_to_date",
    KitName="Objects",
    OutputWrappers="https://staging.speckle.dev\tf0f3a34460\t4284280641",
    UseDefaultCache=True)  # -> Commits, ObjectId, Data
panel = Panel(send.Commits)
panel_2 = Panel(send_2.Commits)
panel_3 = Panel(send_3.Commits)
panel_4 = Panel(send_4.Commits)
panel_5 = Panel(send_5.Commits)
receive = Receive(
    ID=panel,
    AutoReceive=False,
    CurrentComponentState="expired",
    KitName="Objects",
    LastInfoMessage="Dimitrie Stefanescu @ 2020-10-27T13:44:30.987Z: Grasshopper push. (id:22f9cca677)",
    ReceivedObjectId="a9e18d0b81bdf97ffa6f88c6b5aa3801",
    StreamWrapper="https://staging.speckle.dev/streams/f0f3a34460/commits/22f9cca677")  # -> Data, Info
receive_2 = Receive(
    ID=panel_2,
    AutoReceive=False,
    CurrentComponentState="expired",
    KitName="Objects",
    LastInfoMessage="Dimitrie Stefanescu @ 2020-10-27T13:35:10.648Z: Grasshopper push. (id:83a671d026)",
    ReceivedObjectId="d2cc8c14b2c4cadca227237ee91f828b",
    StreamWrapper="https://staging.speckle.dev/streams/f0f3a34460/commits/83a671d026")  # -> Data, Info
receive_3 = Receive(
    ID=panel_3,
    AutoReceive=False,
    CurrentComponentState="expired",
    KitName="Objects",
    LastInfoMessage="Dimitrie Stefanescu @ 2020-10-27T13:33:00.703Z: Grasshopper push. (id:0c92ac4961)",
    ReceivedObjectId="63f70f699df04cdeaa6242da2d60fb31",
    StreamWrapper="https://staging.speckle.dev/streams/f0f3a34460/commits/dfea28eaca")  # -> Data, Info
receive_4 = Receive(
    ID=panel_4,
    AutoReceive=False,
    CurrentComponentState="expired",
    KitName="Objects",
    LastInfoMessage="Dimitrie Stefanescu @ 2020-10-27T13:34:42.819Z: Grasshopper push. (id:4280482899)",
    ReceivedObjectId="794eb07f85dace3fa1eea8e252aaf2af",
    StreamWrapper="https://staging.speckle.dev/streams/f0f3a34460/commits/4280482899")  # -> Data, Info
receive_5 = Receive(
    ID=panel_5,
    AutoReceive=False,
    CurrentComponentState="up_to_date",
    KitName="Objects",
    LastInfoMessage="Dimitrie Stefanescu @ 2020-10-27T14:05:42.313Z: Grasshopper push. (id:4284280641)",
    ReceivedObjectId="c6b656c4f3109f34554175c4cdc20e3f",
    StreamWrapper="https://staging.speckle.dev/streams/f0f3a34460/commits/4284280641")  # -> Data, Info
panel_6 = Panel(receive_2.Data)
panel_7 = Panel(receive_3.Data)
eso_2 = ExpandSpeckleObject(SpeckleObject=receive_4.Data)  # -> A, B, C
geo = Geometry(receive_5.Data)
panel_8 = Panel(receive.Data)
panel_9 = Panel(geo)
