# Grasshopper definition ObjectManagementNodes.ghx (Grasshopper 1.0.7)
# plug-ins: Speckle 2

point = Point([Point(-9, -6, 0), Point(-8, -10, 0), Point(-2, -5, 0), Point(-2, 0, 0), Point(11, 15, 0), Point(14, 14, 0), Point(8, 3, 0)])
interpolate = Interpolate(Vertices=point, Degree=3, Periodic=False, KnotStyle=1)  # -> Curve, Length, Domain
# Speckle 2.0 - Alpha Release
# Object Management Nodes
sphere = Sphere(Base=PlaneXY(0, 0, 0), Radius=1)
xy_plane = XYPlane(Origin=Point(0, 0, 0))
center_box = CenterBox(Base=PlaneXY(0, 0, 0), X=1, Y=1, Z=1)

merge = Merge(Data1=sphere, Data2=center_box, Data3=xy_plane, Data4=interpolate.Curve)

# ----
# Create Speckle object by Key/Value Pairs
values = Panel(merge)
keys = Panel("""sphere
box
plane
curve""")
create_object_by_key_value = CreateObjectByKeyValue(Keys=keys, Values=merge)
panel = Panel(create_object_by_key_value)

# ----
# Create Speckle object
create_speckle_object = CreateSpeckleObject(Sphere=sphere, Box=center_box, Plane=xy_plane, Curve=interpolate.Curve)

# ----
# Extend Speckle object
# Add new keys to a speckle object. If the desired value is a list, each list must be in it's own branch.
char_sequence = CharSequence(Count=10, CharPool="ABCDEFGHIJKLMNOPQRSTUVWXYZ", Format="{0}")
series = Series(Start=0, Step=1, Count=10)
panel_2 = Panel("""newKey1
newKey2""")
entwine = Entwine(Branch00=series, Branch01=char_sequence, FlattenInputs=True)
extend_speckle_object = ExtendSpeckleObject(SpeckleObject=create_object_by_key_value, Keys=panel_2, Values=entwine)
expand_speckle_object = ExpandSpeckleObject(SpeckleObject=extend_speckle_object)  # -> Box, Curve, NewKey1, NewKey2, Plane, Sphere
panel_3 = Panel(expand_speckle_object.NewKey1)
panel_4 = Panel(expand_speckle_object.NewKey2)

# ----
# Get the value of the specified key
panel_5 = Panel("""sphere
plane
box""")
speckle_object_value_by_key = SpeckleObjectValueByKey(SpeckleObject=create_object_by_key_value, Key=panel_5)
panel_6 = Panel(speckle_object_value_by_key)

# ----
# Expand Speckle Object
# Gives access to all keys in the provided objects.
expand_speckle_object_2 = ExpandSpeckleObject(SpeckleObject=create_object_by_key_value)  # -> Box, Curve, Plane, Sphere
