# Grasshopper definition ExpandObjectTestCables.ghx (Grasshopper 1.0.7)
# plug-ins: Speckle 2

series = Series(Start=0, Step=1, Count=Slider(6, range=0..10))
series_2 = Series(Start=0, Step=1, Count=Slider(1, range=0..10))
k_v_async = CreateSpeckleObjectByKeyValueAsync(Keys=series, Values=reverse(series))
k_v_async_2 = CreateSpeckleObjectByKeyValueAsync(Keys=series_2, Values=reverse(series_2))
eso = ExpandSpeckleObject(SpeckleObject=k_v_async)  # -> _0, _1, _2, _3, _4, _5
panel = Panel(eso._2)
