# Grasshopper definition AsyncIntegrationTest.ghx (Grasshopper 1.0.7)
# plug-ins: Speckle 2

random = Random(Range="1 to 2", Number="1000", Seed=2)
sphere = Sphere(Base=PlaneXY(0, 0, 0), Radius=random)
series = Series(Start=0, Step=1, Count=10)
xy_plane = XYPlane(Origin=Point(0, 0, 0))
entwine = Entwine(Branch00=sphere, FlattenInputs=True)
panel = Panel(sphere)
create_speckle_object_async = CreateSpeckleObjectAsync(Bac=series, Sac=sphere, Lac=xy_plane)
create_speckle_object = CreateSpeckleObject(Bac=series, Sac=sphere, Lac=xy_plane)  # disabled
extend_speckle_object = ExtendSpeckleObject(SpeckleObject=create_speckle_object_async, Keys="A", Values=entwine)  # disabled
panel_2 = Panel("""A
@bac""")  # disabled
expand_speckle_object = ExpandSpeckleObject(SpeckleObject=create_speckle_object)  # disabled
point = Point(Point(0, 2.42, 1.34))  # disabled
expand_speckle_object_2 = ExpandSpeckleObject(SpeckleObject=extend_speckle_object)  # -> Bac, Sac, Lac, A; disabled
expand_speckle_object_3 = ExpandSpeckleObject(SpeckleObject=create_speckle_object_async)  # -> Bac, Sac, Lac; disabled
speckle_object_value_by_key = SpeckleObjectValueByKey(Object=extend_speckle_object, Key=panel_2)  # disabled
plane_normal = PlaneNormal(Origin=point, ZAxis=point)  # disabled
plane = Plane(expand_speckle_object_3.Lac)
panel_3 = Panel(create_speckle_object_async)
