# Grasshopper definition BrepSendReceiveTest.ghx (Grasshopper 1.0.7)
# plug-ins: Speckle 2

# ----
# Doubleclick Me!
number_slider = Slider(2.748, range=1.5..3)
number_slider_2 = Slider(1, range=0.8..1.4)
number_slider_3 = Slider(1.2, range=0.8..1.4)
number_slider_4 = Slider(5, range=0..10)
box = CenterBox(Base=PlaneXY(0, 0, 0), X=number_slider, Y=number_slider, Z=number_slider)
box_2 = CenterBox(Base=PlaneXY(0, 0, 0), X=number_slider_2, Y=number_slider_3, Z=number_slider_4)
box_3 = CenterBox(Base=PlaneXY(0, 0, 0), X=number_slider_4, Y=number_slider_2, Z=number_slider_3)
sdiff = SolidDifference(BrepsA=box, BrepsB=flatten(box_3))

division = Division(A=number_slider, B=2)
neg = Negative(Value=number_slider)
dom = ConstructDomain(DomainStart=neg, DomainEnd=number_slider)
range = Range(Domain=dom, Steps=10)
number_slider_5 = Slider(0.1, range=0..0.1)
pt = ConstructPoint(XCoordinate=graft(range), YCoordinate=range, ZCoordinate=neg)
multiplication = Multiplication(A=number_slider, B=3)
box_4 = DomainBox(Base=pt, X=number_slider_5, Y=number_slider_5, Z=multiplication)
create = CreateStream()
cso = CreateSpeckleObject(A=sdiff)

receive = Receive(
    ID=create,
    AutoReceive=True,
    CurrentComponentState="up_to_date",
    KitName="Objects",
    LastInfoMessage="Alan Rynne @ 2020-10-30T11:59:53.887Z: Grasshopper push. (id:2fa4276ad8)",
    ReceivedObjectId="81216bb799d767423eb1a92c4c71b026",
    StreamWrapper="https://staging.speckle.dev/streams/a89da52536?u=4f3b8d2197550b86f070c641aebd21a8")  # -> Data, Info
eso = ExpandSpeckleObject(SpeckleObject=receive.Data)  # -> A, TotalChildrenCount
brep = Brep(eso.A)

send = Send(
    Data=cso,
    Stream=create,
    Branch="main",
    AutoSend=True,
    BaseId="81216bb799d767423eb1a92c4c71b026",
    CurrentComponentState="up_to_date",
    KitName="Objects",
    OutputWrappers="https://staging.speckle.dev\ta89da52536\t2fa4276ad8",
    UseDefaultCache=False)  # -> Commits, ObjectId, Data
panel = Panel(send.Commits)

preview = CustomPreview(
    Geometry=brep,
    Material={diffuse=RGB(230, 230, 230), emission=RGB(0, 0, 0), shine=0, specular=RGB(0, 0, 0), transparency=0})
