# Grasshopper definition CreateSpeckleObjectTests-WithGeometry.ghx (Grasshopper 1.0.7)
# plug-ins: Speckle 2

series = Series(Start=0, Step=1, Count=10)
panel = Panel("""foo
bar
baz""")
lng = ListLength(List=panel)
msphere = MeshSphere(Base=PlaneXY(0, 0, 0), Radius=series, UCount=10, VCount=20)
pt = ConstructPoint(XCoordinate=0, YCoordinate=series, ZCoordinate=0)
vec = VectorXYZ(XComponent=0, YComponent=0, ZComponent=series)  # -> Vector, Length
sph = Sphere(Base=PlaneXY(0, 0, 0), Radius=series)
series_2 = Series(Start=0, Step=1, Count=lng)
pt_2 = ConstructPoint(XCoordinate=0, YCoordinate=series_2, ZCoordinate=0)
cso = CreateSpeckleObject(Abc=[msphere, vec.Vector, pt], Def=sph)  # -> Debug, SpeckleObject
create_object_by_key_value = CreateObjectByKeyValue(Keys=panel, Values=pt_2)  # -> Object, Debug
