# Grasshopper definition ExpandObjectTest.ghx (Grasshopper 1.0.7)
# plug-ins: Speckle 2

sph = Sphere(Base=PlaneXY(0, 0, 0), Radius=1)
sph_2 = Sphere(Base=PlaneXY(0, 0, 0), Radius=1)
panel = Panel("""ABCD
BCDE""")
cso = CreateSpeckleObject(A=sph_2)  # -> Debug, SpeckleObject
cso_2 = CreateSpeckleObject(A=sph_2)  # -> Debug, SpeckleObject
eso = ExpandSpeckleObject(SpeckleObject=cso.SpeckleObject)
panel_2 = Panel(cso_2.SpeckleObject)
