# Grasshopper definition ExtendObjectTest.ghx (Grasshopper 1.0.7)
# plug-ins: Speckle 2, Bifocals

accounts = Accounts(
    {"Account (alan@rynne.es | http://localhost:3000)": "c17e3b5af2f177869a733cca10850355", "Account (alan@speckle.systems | https://staging.speckle.dev)": "4f3b8d2197550b86f070c641aebd21a8"}, selected="Account (alan@rynne.es | http://localhost:3000)",
    selectedId="c17e3b5af2f177869a733cca10850355",
    selectedServer="http://localhost:3000")
list = Accounts(
    {"Account (alan@rynne.es | http://localhost:3000)": "c17e3b5af2f177869a733cca10850355"}, selected="Account (alan@rynne.es | http://localhost:3000)",
    selectedId="c17e3b5af2f177869a733cca10850355",
    selectedServer="http://localhost:3000")
panel = Panel("""A
B""")
random = Random(Range="1 to 6", Number=Slider(10, range=0..10000), Seed=2)  # -> simplify(Random)
sph = Sphere(Base=PlaneXY(0, 0, 0), Radius=random)  # -> simplify(Sphere)
cyl = Cylinder(Base=PlaneXY(0, 0, 0), Radius=random, Length=1)
panel_2 = Panel("""ABBC
CCD""")
entwine = Entwine(Branch00=panel, Branch01=cyl, FlattenInputs=True)  # -> simplify(Result)
entwine_2 = Entwine(Branch00=sph, Branch01=panel, FlattenInputs=True)  # -> simplify(Result)
entwine_3 = Entwine(Branch0X=simplify(entwine), Branch1X=entwine_2, FlattenInputs=False)  # -> simplify(Result)
id_9abc86882e = CreateStream(Account=list, stream="9abc86882e http://localhost:3000 c17e3b5af2f177869a733cca10850355")
entwine_4 = Entwine(Branch00=panel_2, Branch01=panel_2, FlattenInputs=True)  # -> simplify(Result)
k_v_async = CreateSpeckleObjectByKeyValueAsync(Keys=entwine_4, Values=entwine_3)
create_object_by_key_value = CreateObjectByKeyValue(Keys=panel_2, Values=entwine_3)
cso = CreateSpeckleObject(A=sph, B="/Original", C="/Original")
create_object_by_key_value_2 = CreateObjectByKeyValue(Keys=entwine_4, Values=entwine_3)
sup = StreamUpdate(Stream=id_9abc86882e, Name="asdfas", Description="desc", Public=Toggle(True))
slist = StreamList(Account=list, Limit=10)
id_5f843f1aaa = CreateStream(Account=accounts, stream="5f843f1aaa http://localhost:3000 c17e3b5af2f177869a733cca10850355")
expand_speckle_object = ExpandSpeckleObject(SpeckleObject=cso)  # -> A, B, C
panel_3 = Panel(k_v_async)
expand_speckle_object_2 = ExpandSpeckleObject(SpeckleObject=k_v_async)  # -> ABBC, CCD
item = ListItem(List=flatten(create_object_by_key_value_2), Index=0, Wrap=True)  # -> Item, Item1
sget = StreamGet(StreamID=sup, Account=list)
receive = Receive(
    ID=id_5f843f1aaa,
    AutoReceive=True,
    CurrentComponentState="up_to_date",
    KitName="Objects",
    LastInfoMessage="Alan Rynne @ 2020-10-26T11:30:41.728Z: Grasshopper push. (id:e4c2781101)",
    ReceivedObjectId="a1c24d30fc220fe2920bda5b91d6c737",
    StreamWrapper="http://localhost:3000/streams/5f843f1aaa?u=c17e3b5af2f177869a733cca10850355")  # -> Data, Info
panel_4 = Panel([expand_speckle_object_2.CCD, expand_speckle_object.C])
send = Send(
    Data=create_object_by_key_value,
    Stream=id_5f843f1aaa,
    Branch="main",
    AutoSend=False,
    BaseId="a1c24d30fc220fe2920bda5b91d6c737",
    CurrentComponentState="expired",
    KitName="Objects",
    OutputWrappers="http://localhost:3000\t5f843f1aaa\te4c2781101",
    UseDefaultCache=True)  # -> Commits, ObjectId, Data
sdet = StreamDetails(StreamID=sget)  # -> StreamID, Name, Description, CreatedAt, UpdatedAt, Public, Collaborators, Branches
panel_5 = Panel([sdet.Name, sdet.Description, sdet.Public])
sb = SpeckleBase(panel_5)
panel_6 = Panel(sb)
