# Grasshopper definition KeyValueTest.ghx (Grasshopper 1.0.7)
# plug-ins: Speckle 2

number_slider = Slider(3, range=0..100)
panel = Panel("""A
B""")
series = Series(Start=0, Step=1, Count=number_slider)  # -> simplify(Series)
series_2 = Series(Start=Slider(5, range=0..10), Step=1, Count=number_slider)  # -> simplify(Series)
entwine = Entwine(Branch0X=graft(series), Branch1X=series_2, FlattenInputs=False)  # -> simplify(Result)
create_speckle_object = CreateSpeckleObject(A="Test", B=series)  # -> Debug, SpeckleObject
create_speckle_object_2 = CreateSpeckleObject(A=series_2, B=panel)  # -> Debug, SpeckleObject
entwine_2 = Entwine(Branch00="1", Branch01=series_2, Branch02="1", FlattenInputs=True)
create_object_by_key_value = CreateObjectByKeyValue(Keys=series, Values=entwine)  # -> Object, Debug
merge = Merge(Data1=create_speckle_object.SpeckleObject, Data2=create_speckle_object_2.SpeckleObject)  # -> graft(Result)
expand_speckle_object = ExpandSpeckleObject(SpeckleObject=create_object_by_key_value.Object)  # -> _0, _1, _2
speckle_object_value_by_key = SpeckleObjectValueByKey(Object=merge, Key=panel)  # -> simplify(Value), Debug
panel_2 = Panel(speckle_object_value_by_key.Value)
panel_3 = Panel(expand_speckle_object._2)
