# Grasshopper definition StreamsTest.ghx (Grasshopper 1.0.7)
# plug-ins: Speckle 2

accounts = Accounts(
    {"Account (alan@rynne.es | http://localhost:3000)": "c17e3b5af2f177869a733cca10850355"}, selected="Account (alan@rynne.es | http://localhost:3000)",
    selectedId="c17e3b5af2f177869a733cca10850355",
    selectedServer="http://localhost:3000")
stream_list = StreamList(Account=accounts, Limit=10)
id_6eae58233b = CreateStream(Account=accounts, stream="6eae58233b http://localhost:3000 c17e3b5af2f177869a733cca10850355")
stream_details = StreamDetails(StreamID=id_6eae58233b, Account=accounts)  # -> StreamID, Name, Description, CreatedAt, UpdatedAt, Public, Collaborators, Branches
