# Grasshopper definition schema-builder.gh (Grasshopper 1.0.7)
# plug-ins: Speckle 2

number_slider = Slider(3, range=-2..10)
crv = Curve(<curve referenced from the Rhino model>)
explode = Explode(Curve=crv, Recursive=True)  # -> Segments, Vertices
item = ListItem(List=explode.Segments, Index=number_slider, Wrap=True)
cull_i = CullIndex(List=explode.Segments, Indices=number_slider, Wrap=True)
lng = ListLength(List=cull_i)
series = Series(Start=0, Step=1, Count=lng)

# ---- group: Parameter
internalname_will_prevail_over_name_if_u = Panel("ALL_MODEL_INSTANCE_COMMENTS")  # "InternalName will prevail over Name if used"
concat = Concatenate(FragmentA="Hi I'm a comment on wall #", FragmentB=series)
cso = Parameter(Name="Comments", Value=concat, seed="c61185d0fd0c1b2fc19b")  # -> graft(SpeckleObject)

# ---- group: Levels
cso_2 = LevelByName(Name="Level 2", seed="105d884f905a21cf5aaf")
cso_3 = LevelByName(Name="Level 1", seed="238b03bcfaf90d0b6372")

# ---- group: Exterior walls
panel = Panel("Generic - 200mm")
panel_2 = Panel("Basic Wall")
crv_2 = Curve(cull_i)

# ---- group: Door
item_2 = ListItem(List=crv_2, Index=Slider(6, range=-2..10), Wrap=True)
panel_3 = Panel("M_Single-Flush")
curvepoint = PointOnCurve(item_2, parameter=0.526)
panel_4 = Panel("0915 x 2134mm")
lng_2 = ListLength(List=crv_2)

# ---- group: Windows
panel_5 = Panel("""0
1
2
3
4
5""")
item_3 = ListItem(List=crv_2, Index=panel_5, Wrap=True)
panel_6 = Panel("M_Fixed")
curvepoint_2 = PointOnCurve(item_3, parameter=0.744)
panel_7 = Panel("2000 x 1830mm")
lng_3 = ListLength(List=crv_2)

# ---- group: Curtain wall
panel_8 = Panel("Storefront")
panel_9 = Panel("Curtain Wall")
crv_3 = Curve(item)

# ---- group: Floor
panel_10 = Panel("Generic 150mm")
panel_11 = Panel("Floor")
join = JoinCurves(Curves=crv_3, Preserve=False)
crv_4 = Curve(crv)
offset = OffsetCurve(Curve=crv_4, Distance=Slider(0.1, range=0..0.1), Plane=PlaneXY(0, 0, 0), Corners=1)

# ---- group: Roof
panel_12 = Panel("Generic - 400mm")
panel_13 = Panel("Basic Roof")
crv_5 = Curve(<curve referenced from the Rhino model>)

# ---- group: Trees
panel_14 = Panel("American Beech - 6.0 Meters")
panel_15 = Panel("M_RPC Tree - Deciduous")
pt = Point([<point referenced from the Rhino model> x6])

# ---- group: Columns
Z = UnitZ(Factor=1)
pt_2 = Point([<point referenced from the Rhino model> x2])
move = Move(Geometry=pt_2, Motion=Z)  # -> Geometry, Transform
panel_16 = Panel("M_Rectangular Column")
panel_17 = Panel("475 x 610mm")
ln = Line(StartPoint=pt_2, EndPoint=move.Geometry)

# ---- group: Railing
panel_18 = Panel("Glass Panel - Bottom Fill")
crv_6 = Curve(<curve referenced from the Rhino model>)

# ----
cso_4 = RevitFloor(Family=panel_11, Type=panel_10, Outline=offset, Level=cso_3, seed="984f1d6190d0f90331d9")
cso_5 = WallByCurveAndLevels(Family=panel_9, Type=panel_8, BaseLine=crv_3, Level=cso_3, TopLevel=cso_2, seed="555913aa5051245db367")
cso_6 = RevitFootprintRoof(Outline=crv_5, Family=panel_13, Type=panel_12, Level=cso_2, seed="c1dbf73b323c83cd3028")
cso_7 = FamilyInstance(BasePoint=curvepoint_2, Family=panel_6, Type=panel_7, Level=cso_3, seed="a86527837da1180d58ea")
cso_8 = FamilyInstance(BasePoint=pt, Family=panel_15, Type=panel_14, Level=cso_3, seed="0629b8ab280bd31a5205")
cso_9 = FamilyInstance(BasePoint=curvepoint, Family=panel_3, Type=panel_4, Level=cso_3, seed="c01cd222bfde56a13164")
cso_10 = VerticalColumn(Family=panel_16, Type=panel_17, BaseLine=ln, Level=cso_3, TopLevel=cso_2, seed="d30546a3162849a64587")
cso_11 = Railing(Type=panel_18, BaseCurve=crv_6, Level=cso_3, seed="71dff8ca162acefba884")
merge = Merge(Data1=cso_7, Data2=cso_9)  # -> graft(Result)
cso_12 = WallByCurveAndLevels(
    Family=panel_2,
    Type=panel,
    BaseLine=graft(crv_2),
    Level=cso_3,
    TopLevel=cso_2,
    Elements=merge,
    Parameters=cso,
    seed="6efeef0aaaa4d0502366")

# ---- group: Add items at indices
c_script = CSharpScript()  # -> out, flatten(A); inputs items: list, indices: list of Int32, length: Int32
# ---------- c_script: C# ----------
    var objects = new List<object>();
    for(var i = 0; i < length; i++){
      if(indices.Contains(i))
        objects.Add(items[i]);
      else
        objects.Add(null);
    }
    A = objects;
# ---------- end c_script ----------

# ----
line = Line(Line((-22.43182415, -10.7577012, 0), (7.227559854, -13.36772699, 0)))
merge_2 = Merge(Data1=cso_12, Data2=cso_5, Data4=cso_6, Data5=cso_7, Data6=cso_8, Data7=cso_10, Data8=cso_11)
send = Send(
    Data=merge_2,
    Stream="https://staging.speckle.dev/streams/b710c1a443",
    Branch="main",
    AutoSend=False,
    BaseId="bdcaaac6cf3b32475d038e9413e18f93",
    CurrentComponentState="expired",
    KitName="Objects",
    OutputWrappers="https://staging.speckle.dev\tb710c1a443\t00ef33130c",
    UseDefaultCache=True)  # -> Commits, ObjectId, Data
