# Grasshopper definition AllGeometryConversionTest.gh (Grasshopper 1.0.7)
# plug-ins: Speckle 2

list = Accounts(
    {"Account (alan@speckle.systems | https://staging.speckle.dev)": "4f3b8d2197550b86f070c641aebd21a8"}, selected="Account (alan@speckle.systems | https://staging.speckle.dev)",
    selectedId="4f3b8d2197550b86f070c641aebd21a8",
    selectedServer="https://staging.speckle.dev")
id_7f8ca3cb22 = CreateStream(Account=list, stream="7f8ca3cb22 https://staging.speckle.dev 4f3b8d2197550b86f070c641aebd21a8")
pline = PolyLine(
    Vertices=[Point(-21, -13, 0), Point(-26, -1, 0), Point(-12, 1, 0), Point(-18, 11, 0), Point(-2, 13, 0), Point(-2, 26, 0)],
    Closed=False)
pt = Point(Point(15.14890394, 1, 1))
line = Line(Line((6, -6, 0), (8, 14, 0)))
merge = Merge(Data1=pt, Data2=line, Data3=pline)
to_speckle = ToSpeckle(Objects=merge, KitName="Objects")
eso = ExpandSpeckleObject(SpeckleObject=to_speckle)  # -> Area, Bbox, Closed, Domain, Length, Points, Value, X, Y, Z
panel = Panel(eso.Bbox)
