# Grasshopper definition ExpandObjectTest.ghx (Grasshopper 1.0.7)
# plug-ins: Speckle 2

panel = Panel("""ABCD
BCDE""")
sph = Sphere(Base=PlaneXY(0, 0, 0), Radius=1)
sph_2 = Sphere(Base=PlaneXY(0, 0, 0), Radius=1)
cso = CreateSpeckleObject(A=panel)  # -> Debug, SpeckleObject
cso_2 = CreateSpeckleObject(A=sph_2)  # -> Debug, SpeckleObject
panel_2 = Panel("""somasdf
someasdf
some3""")
entwine = Entwine(Branch00=panel, FlattenInputs=True)
eso = ExtendSpeckleObject(SpeckleObject=cso.SpeckleObject, Keys=panel_2, Values=panel_2)
panel_3 = Panel(cso_2.SpeckleObject)
eso_2 = ExpandSpeckleObject(SpeckleObject=eso)  # -> A, Somasdf, Someasdf, Some3
panel_4 = Panel(eso_2.A)
