# Grasshopper definition LocalSendReceiveTest.ghx (Grasshopper 1.0.7)
# plug-ins: Speckle 2

series = Series(Start=0, Step=1, Count=10)
sph = Sphere(Base=PlaneXY(0, 0, 0), Radius=1)
mesh = Mesh(sph)
lsa = LocalSendAsync(Data=mesh)
lsa_2 = LocalReceiveAsync(LocalDataId=lsa)
panel = Panel(lsa_2)
