# Grasshopper definition StreamsTest.ghx (Grasshopper 1.0.7)
# plug-ins: Speckle 2, Bifocals

panel = Panel("Relay")
accounts = Accounts(
    {"Account (alan@rynne.es | http://localhost:3000)": "c17e3b5af2f177869a733cca10850355"}, selected="Account (alan@rynne.es | http://localhost:3000)",
    selectedId="c17e3b5af2f177869a733cca10850355",
    selectedServer="http://localhost:3000")
stream_list = StreamList(Account=accounts, Limit=10)
id_7bb91b34b9 = CreateStream(stream="7bb91b34b9 http://localhost:3000 c17e3b5af2f177869a733cca10850355")
stream_details = StreamDetails(StreamID=id_7bb91b34b9)  # -> StreamID, Name, Description, CreatedAt, UpdatedAt, Public, Collaborators, Branches
stream_update = StreamUpdate(Stream=id_7bb91b34b9, Name="hello", Description="hello")
stream_get = StreamGet(StreamID=stream_details.StreamID)
