# Grasshopper definition SurfaceTests.ghx (Grasshopper 1.0.7)
# plug-ins: Speckle 2

number_slider = Slider(10, range=0..10)
accounts = Accounts(
    {"Account (alan@rynne.es | https://staging.speckle.dev)": "ead7b5bb692081ceb2ed3cde2b088187", "Account (alan@rynne.es | http://localhost:3000)": "c17e3b5af2f177869a733cca10850355", "Account (alan@speckle.systems | https://staging.speckle.dev)": "4f3b8d2197550b86f070c641aebd21a8"}, selected="Account (alan@rynne.es | http://localhost:3000)",
    selectedId="c17e3b5af2f177869a733cca10850355",
    selectedServer="http://localhost:3000")
accounts_2 = Accounts(
    {"Account (alan@rynne.es | https://staging.speckle.dev)": "ead7b5bb692081ceb2ed3cde2b088187", "Account (alan@rynne.es | http://localhost:3000)": "c17e3b5af2f177869a733cca10850355", "Account (alan@speckle.systems | https://staging.speckle.dev)": "4f3b8d2197550b86f070c641aebd21a8"}, selected="Account (alan@rynne.es | https://staging.speckle.dev)",
    selectedId="ead7b5bb692081ceb2ed3cde2b088187",
    selectedServer="https://staging.speckle.dev")
series = Series(Start=0, Step=1, Count=Slider(4, range=0..10))
series_2 = Series(Start=0, Step=1, Count=number_slider)
construct_point = ConstructPoint(XCoordinate=graft(series_2), YCoordinate=series, ZCoordinate=graft(0))
list_length = ListLength(List=flatten(construct_point))
random = Random(Range=Domain(0, 1), Number=list_length, Seed=2)
unflatten_tree = UnflattenTree(Tree=random, Guide=construct_point)
unit_z = UnitZ(Factor=unflatten_tree)
move = Move(Geometry=construct_point, Motion=unit_z)  # -> Geometry, Transform
surface_from_points = SurfaceFromPoints(Points=flatten(move.Geometry), UCount=number_slider, Interpolate=False)
custom_preview = CustomPreview(Geometry=surface_from_points, Material=ColourSwatch(SwatchColor=RGB(0, 166, 255)))
id_cc631d854e = CreateStream(Account=accounts, stream="cc631d854e http://localhost:3000 c17e3b5af2f177869a733cca10850355")
create_speckle_object = CreateSpeckleObject(A=surface_from_points)
id_7ed7a7d55e = CreateStream(Account=accounts_2, stream="7ed7a7d55e https://staging.speckle.dev ead7b5bb692081ceb2ed3cde2b088187")

create_speckle_object_2 = CreateSpeckleObject(A=surface_from_points)  # disabled
serialize = Serialize(O=create_speckle_object_2)  # disabled
deserialize = Deserialize(O=serialize)  # disabled
expand_speckle_object = ExpandSpeckleObject(SpeckleObject=create_speckle_object_2)  # disabled
expand_speckle_object_2 = ExpandSpeckleObject(SpeckleObject=deserialize)  # disabled
panel = Panel(expand_speckle_object)  # disabled
panel_2 = Panel(expand_speckle_object_2)  # disabled
surface = Surface(expand_speckle_object)  # disabled
surface_2 = Surface(expand_speckle_object_2)  # disabled

send = Send(
    Data=create_speckle_object,
    Stream=id_7ed7a7d55e,
    Branch="main",
    AutoSend=True,
    BaseId="e9dcd4ea41ceebf1870c8d0c768f5233",
    CurrentComponentState="up_to_date",
    KitName="Objects",
    OutputWrappers="https://staging.speckle.dev\t7ed7a7d55e\t59ad303209",
    UseDefaultCache=False)  # -> Commits, ObjectId, Data
receive = Receive(
    Stream=id_7ed7a7d55e,
    AutoReceive=True,
    CurrentComponentState="up_to_date",
    KitName="Objects",
    LastInfoMessage="Alan Rynne @ 2020-11-06T14:29:29.230Z: Grasshopper push. (id:59ad303209)",
    ReceivedObjectId="e9dcd4ea41ceebf1870c8d0c768f5233",
    StreamWrapper="https://staging.speckle.dev/streams/7ed7a7d55e?u=ead7b5bb692081ceb2ed3cde2b088187")  # -> Data, Info

# ---- group: Conversion Nodes
to_speckle = ToSpeckle(Objects=surface_from_points, KitName="Objects")  # disabled
serialize_2 = Serialize(O=to_speckle)  # disabled
deserialize_2 = Deserialize(O=serialize_2)  # disabled
to_native = ToNative(Objects=to_speckle, KitName="Objects")  # disabled
to_native_2 = ToNative(Objects=deserialize_2, KitName="Objects")  # disabled
panel_3 = Panel(to_native)  # disabled
panel_4 = Panel(to_native_2)  # disabled
surface_3 = Surface(to_native)  # disabled
surface_4 = Surface(to_native_2)  # disabled

# ----
expand_speckle_object_3 = ExpandSpeckleObject(SpeckleObject=receive.Data)
panel_5 = Panel(id_7ed7a7d55e)
serialize_3 = Serialize(O=send.Data)
surface_5 = Surface(expand_speckle_object_3)
panel_6 = Panel(expand_speckle_object_3)
