# Grasshopper definition SendReceive.ghx (Grasshopper 1.0.7)
# plug-ins: Speckle 2

# ----
# Get a stream from the server and receive the data
panel = Panel("Paste stream ID here!")
stream_get = StreamGet(StreamID=panel)
receive = Receive(Stream=stream_get, AutoReceive=False, CurrentComponentState="needs_input", KitName="Objects")  # -> Data, Info
panel_2 = Panel(receive.Data)

# ----
# Speckle 2.0 - Alpha Release
# Sending / Receiving Data
# Create a new stream and send data
# Connect an account node here!
create_stream = CreateStream()
mock_data = Panel("Some data to send....")
send = Send(
    Data=mock_data,
    Stream=create_stream,
    Branch="main",
    AutoSend=False,
    CurrentComponentState="needs_input",
    KitName="Objects",
    UseDefaultCache=True)  # -> Commits, ObjectId, Data

# ----
# Receiving a specific commit from a stream
panel_3 = Panel(send.Commits)
receive_2 = Receive(Stream=panel_3, AutoReceive=False, CurrentComponentState="needs_input", KitName="Objects")  # -> Data, Info
